# Grasshopper definition transfinite.gh (Grasshopper 1.0.7)
# plug-ins: Transfinite

u_scale = U_scale(40)
nickname = Transfinite(U=0, V=0, U_scale=u_scale, V_scale=40, N=3)  # -> Curves, DomainPolygon, Landa, Kappa, Nu, Kato, Kato_pointlist, Patches, PlnError
crv = Curve(nickname.Curves)
srfgrid = SurfaceFromPoints(Points=nickname.Kato_pointlist, UCount=expr("x+1", u_scale), Interpolate=False)
